# Grasshopper definition Circles.ghx (Grasshopper 0.9.76)

denominator = Data()
numerator = Number()
series = Series(Start=0, Step=1, Count=numerator)
Z = UnitZ(Factor=series)
circle = CircleCNR(Center=Point(0, 0, 0), Normal=Vector(0, 0, 1), Radius=denominator)
move = Move(Geometry=circle, Motion=Z)  # -> flatten(Geometry), Transform
result = Data(move.Geometry)
