# Grasshopper definition Spheres.ghx (Grasshopper 0.9.76)

maxradius = Number()
count = Number()
minradius = Number()
seed = Number()
dom = ConstructDomain(DomainStart=minradius, DomainEnd=maxradius)
pt = Point(Point(0, 0, 0))
pt_2 = Point(Point(10, 10, 10))
box = Box2Pt(PointA=pt, PointB=pt_2, Plane=PlaneXY(0, 0, 0))
random = Random(Range=dom, Number=count, Seed=seed)  # -> flatten(Random)
pop3d = Populate3D(Region=box, Count=count, Seed=1)
sph = Sphere(Base=pop3d, Radius=random)
mesh = MeshBrep(
    Brep=sph,
    Settings={GridMaxCount=0, GridMinCount=16, JaggedSeams=False, MaxEdgeLength=0, MinEdgeLength=0.0001, MinTolerance=0, Refine=True, RefineAngle=0, RelativeTolerance=0.65, SimplePlanes=True, Tolerance=0})
spheres = Mesh(mesh)
