# Grasshopper definition Surface.ghx (Grasshopper 0.9.76)

xdim = Number()
ydim = Number()
maxz = Number()
seed = Number()
rectangle = Rectangle(Plane=PlaneXY(0, 0, 0), XSize=xdim, YSize=ydim, Radius=0)  # -> Rectangle, Length
number_slider = Slider(10, range=0..10)
boundary = BoundarySurfaces(Edges=rectangle.Rectangle)
sdivide = DivideSurface(Surface=boundary, UCount=number_slider, VCount=number_slider)  # -> flatten(Points), Normals, Parameters
lng = ListLength(List=sdivide.Points)
dom = ConstructDomain(DomainStart=maxz, DomainEnd=1)
subtraction = Subtraction(A=lng, B=1)
random = Random(Range=dom, Number=lng, Seed=seed)
Z = UnitZ(Factor=random)
move = Move(Geometry=sdivide.Points, Motion=Z)  # -> Geometry, Transform
split = SplitList(List=move.Geometry, Index=subtraction)  # -> ListA, ListB
ln = Line(StartPoint=sdivide.Points, EndPoint=move.Geometry)
srfgrid = SurfaceFromPoints(Points=split.ListA, UCount=number_slider, Interpolate=False)
intcrv = Interpolate(Vertices=move.Geometry, Degree=3, Periodic=False, KnotStyle=1)  # -> Curve, Length, Domain
srf = Surface(srfgrid)
pt = Point(move.Geometry)
crv = Curve(intcrv.Curve)
line = Line(ln)
